# Grasshopper definition vertices.gh (Grasshopper 0.9.76)

circle_diam_of_backing_or_square_over_br = Slider(22, range=0..100)  # "Circle Diam of backing or Square over bracket"
corflute_thickness_tolerance = Slider(3.15, range=0..10)
spacing_between_parts = Slider(10, range=0..10)
depth_of_corflute = Slider(60, range=0..100)
diameter_of_milling_bit = Slider(6.54, range=0..10)
led_spacing = Slider(50, range=0..100)
led_diam = Slider(12, range=0..100)
crv = Curve([<curve referenced from the Rhino model> x18])
list = ValueList({"Circle": 0, "Rectangle": 1}, selected="Rectangle")
addition = Addition(A=depth_of_corflute, B=spacing_between_parts)
explode = Explode(Curve=crv, Recursive=True)  # -> Segments, Vertices
division = Division(A=circle_diam_of_backing_or_square_over_br, B=2)
offset = Offset(Curve=crv, Distance=corflute_thickness_tolerance, Plane=PlaneXY(0, 0, 0), Corners=1)
neg = Negative(Value=division)
area = Area(Geometry=crv)  # -> Area, Centroid
divide = DivideCurve(Curve=explode.Segments, Count="1", Kinks=False)  # -> Points, Tangents, Parameters
explode_2 = Explode(Curve=offset, Recursive=True)  # -> Segments, Vertices
lng = ListLength(List=area.Area)
dom = ConstructDomain(DomainStart=division, DomainEnd=neg)
dom_2 = ConstructDomain(DomainStart=division, DomainEnd=neg)
division_2 = Division(A=led_diam, B=2)
len = Length(Curve=explode_2.Segments)
series = Series(Start=1, Step=1, Count=lng)
pdecon = Deconstruct(Point=flatten(divide.Points))  # -> XComponent, YComponent, ZComponent
lng_2 = ListLength(List=flatten(divide.Points))
addition_2 = Addition(A=division_2, B=1)
ma = MassAddition(Input=len)  # -> Result, PartialResults
round = Round(Number=series)  # -> Nearest, Floor, Ceiling
sort = SortList(Keys=pdecon.XComponent)  # -> Keys, ValuesA
subtraction = Subtraction(A=lng_2, B=1)
sort_2 = SortList(Keys=pdecon.YComponent)  # -> Keys, ValuesA
lng_3 = ListLength(List=ma.PartialResults)
number_slider = Slider(3000, range=0..10000)
lng_4 = ListLength(List=flatten(lng_3))
subtraction_2 = Subtraction(A=lng_3, B=1)
item = ListItem(List=sort.Keys, Index="0", Wrap=True)
item_2 = ListItem(List=sort.Keys, Index=subtraction, Wrap=True)
item_3 = ListItem(List=sort_2.Keys, Index="0", Wrap=True)
item_4 = ListItem(List=sort_2.Keys, Index=subtraction, Wrap=True)
item_5 = ListItem(List=ma.PartialResults, Index=subtraction_2, Wrap=True)
series_2 = Series(Start=depth_of_corflute, Step=addition, Count=lng_4)
series_3 = Series(Start=0, Step=addition, Count=lng_4)
addition_3 = Addition(A=number_slider, B=item_5)
dom_3 = ConstructDomain(DomainStart=item, DomainEnd=item_2)
subtraction_3 = Subtraction(A=item_2, B=item)
division_3 = Division(A=subtraction_3, B=led_spacing)
round_2 = Round(Number=division_3)  # -> Nearest, Floor, Ceiling
subtraction_4 = Subtraction(A=round_2.Floor, B=Toggle(False))
multiplication = Multiplication(A=subtraction_4, B=led_spacing)
eval = Evaluate(F="(x-y)/2", x=subtraction_3, y=multiplication)
addition_4 = Addition(A=item, B=eval)
dom_4 = ConstructDomain(DomainStart=item_3, DomainEnd=item_4)
subtraction_5 = Subtraction(A=item_4, B=item_3)
division_4 = Division(A=subtraction_5, B=led_spacing)
round_3 = Round(Number=division_4)  # -> Nearest, Floor, Ceiling
subtraction_6 = Subtraction(A=round_3.Floor, B=Toggle(True))
multiplication_2 = Multiplication(A=subtraction_6, B=led_spacing)
eval_2 = Evaluate(F="(x-y)/2", x=subtraction_5, y=multiplication_2)
addition_5 = Addition(A=item_3, B=eval_2)
pt = ConstructPoint(XCoordinate=addition_4, YCoordinate=addition_5, ZCoordinate=0)
sqgrid = Square(Plane=pt, Size=led_spacing, ExtentX=subtraction_4, ExtentY=subtraction_6)  # -> Cells, Points
dom_5 = ConstructDomain(DomainStart=number_slider, DomainEnd=addition_3)  # -> flatten(Domain)
dom_6 = ConstructDomain(DomainStart=series_3, DomainEnd=series_2)
series_4 = Series(Start=series_3, Step=0, Count=flatten(lng_3))
addition_6 = Addition(A=number_slider, B=ma.PartialResults)
division_5 = Division(A=diameter_of_milling_bit, B=2)
culln = CullNth(List=addition_6, CullFrequency=lng_3)
culln_2 = CullNth(List=series_4, CullFrequency=lng_3)
offset_2 = Offset(Curve=crv, Distance=division_5, Plane=PlaneXY(0, 0, 0), Corners=1)
offset_3 = Offset(Curve=offset_2, Distance=addition_2, Plane=PlaneXY(0, 0, 0), Corners=1)
incurve = PointInCurve(Point=flatten(sqgrid.Points), Curve=offset_3)  # -> Relationship, Point
Y = UnitY(Factor=depth_of_corflute)
cull = CullPattern(List=incurve.Point, CullPattern=incurve.Relationship)
cir = Circle(Plane=cull, Radius=division)
rectangle = Rectangle(Plane=cull, XSize=dom, YSize=dom_2, Radius=0)  # -> Rectangle, Length
group = Group(Objects=cir)
group_2 = Group(Objects=rectangle.Rectangle)
p_n_c = PickNChoose(Pattern=list, Stream0=group, Stream1=group_2)
ungroup = Ungroup(Group=p_n_c)
pt_2 = ConstructPoint(XCoordinate=culln, YCoordinate=culln_2, ZCoordinate=0)
rectangle_2 = Rectangle(Plane=PlaneXY(0, 0, 0), XSize=dom_3, YSize=dom_4, Radius=0)  # -> Rectangle, Length
move = Move(Geometry=pt_2, Motion=Y)  # -> Geometry, Transform
X = UnitX(Factor=Slider(1200, range=0..5000))
X_2 = UnitX(Factor=Slider(1800, range=0..10000))
cir_2 = Circle(Plane=cull, Radius=division_2)
X_3 = UnitX(Factor=Slider(600, range=0..1000))
pt_3 = ConstructPoint(XCoordinate=expr("x+20", number_slider), YCoordinate=expr("x+20", series_3), ZCoordinate=0)
move_2 = Move(Geometry=[rectangle_2.Rectangle, ungroup], Motion=X_2)  # -> Geometry, Transform
move_3 = Move(Geometry=[cir_2, rectangle_2.Rectangle], Motion=X)  # -> Geometry, Transform
cut = Rectangle(Plane=PlaneXY(0, 0, 0), XSize=dom_5, YSize=dom_6, Radius=0)  # -> Rectangle, Length
move_4 = Move(Geometry=[rectangle_2.Rectangle, offset_2], Motion=X_3)  # -> Geometry, Transform
tag = TextTag3D(Location=area.Centroid, Text=round.Nearest, Size=Slider(40, range=0..50), Justification=5)
tag_2 = TextTag3D(Location=pt_3, Text=round.Nearest, Size=Slider(15, range=0..20), Justification=5)
engrave = Line(StartPoint=pt_2, EndPoint=move.Geometry)
